# Grasshopper definition Export to Illustrator.gh (Grasshopper 1.0.7)
# Copyright: 2020
# Copyright: 2018
# plug-ins: FalseStartToggle, Salmon

# ----
# HL TOOLBAR
install = Button()
hl_setup = HLSETUP(installtemplate=install)
panel = Panel(hl_setup)

# ----
# OPEN GH EXAMPLES
false_start_toggle = FalseStartToggle(False)
run_gh = PythonScript(run=false_start_toggle)  # inputs run: Boolean
# ---------- run_gh: Python ----------
import Grasshopper as gh

if _run == True:
    interface = gh.Plugin.GH_RhinoScriptInterface()
    #interface.DisableSolver()
    #gh.Plugin.GH_RhinoScriptInterface.
    interface.OpenDocument("//files\\MergedCompanies\\HenningLarsen\\Denmark\\Copenhagen\\Workspace\\Rhino\\HLA_Grasshopper\\Examples\\000_Examples.gh")
# ---------- end run_gh ----------

# ----
# Update all linked clusters in document
# Create default rhino layers
button = Button()
hl_layer = HL_LAYER(create_missing_layers=button, recreate_all_layers=Button())
updateall = UpdateAllClusters(Run=Button())  # -> update_all; inputs Run: Boolean
# ---------- updateall: C# ----------
    if(Run){
      List<Grasshopper.Kernel.Special.GH_Cluster> AllClusters = GrasshopperDocument.Objects.OfType<Grasshopper.Kernel.Special.GH_Cluster>().ToList();
      List<Grasshopper.Kernel.Special.GH_Cluster> clusters = new List<Grasshopper.Kernel.Special.GH_Cluster>();
      foreach(var clustObject in AllClusters){
        Grasshopper.Kernel.Special.GH_Cluster c = clustObject as Grasshopper.Kernel.Special.GH_Cluster;

        if(c.FilePath != null){
          if(c.Synchronisation == Grasshopper.Kernel.Special.GH_Synchronisation.OutOfDate){
            clusters.Add(c);
          }
        }
      }


      GrasshopperDocument.ScheduleSolution(5, clust => updateClusters(clusters));
    }
# ---------- updateall: C# additional code ----------
  void updateClusters(List<Grasshopper.Kernel.Special.GH_Cluster> clusters){
    foreach(var c in clusters){
      c.CreateFromFilePath(c.FilePath);
      c.ExpireSolution(false);
    }
  }
# ---------- end updateall ----------

# ---- group: g_
# General
# revisions
data = Data(0)

# ---- group: gi_
# HLA_INTERNAL
# Name groups accordingly
# for automatic color:
# Inputs
# Gh Input
# Operations
data_2 = Data(0)

# ---- group: re_
data_3 = Data(0)

# ---- group: ri_
# Rh Input
# Output
data_4 = Data(0)

# ---- group: v_
# Visualization
# User (change these if you like)
data_5 = Data(0)

# ---- group: 1_
data_6 = Data(0)

# ----
# Document Information
initials_last_opened_by = Panel("ARZE")

# ---- group: ei_
# Template
# Script
# Ext Input
data_7 = Data(0)

# ---- group: o_
# Output
data_8 = Data(0)

# ---- group: 2_
data_9 = Data(0)

# ----
export = Button()
crvs = Curve([<curve referenced from the Rhino model> x3])
exportill = ExportToIllusterator(Curves=crvs, Path="--PATH--", Export=export)

# ----
# Grasshopper Version
# File Name
# gh_file: Export to Illustrator.gh
# gh_file_path: C:\Users\Arze\Documents\GitHub\Salmon\Examples\Exports\Export to Illustrator.gh
# Date Updated
# Date Created
# Description
initials_creator = Panel("MIST")
project_number = Panel("0000__")

# ----
# TEMPLATE
# Edit template
# (requires admin)
# Remove HL template
# from this document
strip_definition = Button()
edit = FalseStartToggle(False)
mist = PythonScript(template=edit)  # -> un
# ---------- mist: Python ----------
""" mathias sønderskov """

gh_file_path = ghenv.LocalScope.ghdoc.Path
try:
    gh_file = gh_file_path.split("\\")[-1]
except:
    gh_file = ""
from os import getenv
import rhinoscriptsyntax as rs
import Grasshopper as gh
#import Grasshopper as gh
import Rhino
from datetime import datetime
import scriptcontext as sc
sc.sticky["HLA_Template_edit"] = False
#print gh.Kernel.GH_Document.
def get_atts():
    now = datetime.now()
    D = now.strftime("%Y-%m-%d")
    rhino_file = Rhino.RhinoDoc.ActiveDoc.Name
    
    rhino_full_path = Rhino.RhinoDoc.ActiveDoc.Path
    project_name = "no_name"
    project_number = "0000_"
    try:
        p = rhino_full_path.replace("/","\\").split("\\")
    except:
        p = "rhino-path"

    if ("vmvbg-fs2" in p or "vmvbg-FS1" in p) and \
        ("Competitions" in p or "Projects" in p): #VPN?
        project_name = p[4]
        project_number = project_name[0:4]
    elif p[0] == "K:" or p[0] == "G:": #on hla serv
        project_name = p[1]
        project_number = project_name[0:4]
    return project_name, project_number + "_", rhino_file, rhino_full_path, D

name, project_number, rhino_file, rhino_path, current_date = get_atts()
try:
    rhino_folder = rhino_path.replace("/","\\")
    rhino_folder = "\\".join(rhino_folder.split("\\")[:-1])
except:
    rhino_folder = "rhino.folder"

print name
print project_number
print rhino_file
print rhino_path
print current_date
print gh_file_path

ghObjects = ghenv.Component.OnPingDocument().Objects
try:
    username = getenv('USERNAME')
except:
    username = ""



if _template == True and sc.sticky["HLA_Template_edit"] == False:
    Rhino.UI.Dialogs.ShowMessageBox("This will disable the solver and open the template file.\n" + \
    "When you come back, please enable solver under Solution->Enable solver!\n" + \
    "Also, you don't have permission to edit the template anyway.\n" +\
    " - Mathias Sønderskov 2020","Notice")
    sc.sticky["HLA_Template_edit"] = True
    template = r"W:\Rhino\HLA_Grasshopper\HLA_Template.gh"
    interface = gh.Plugin.GH_RhinoScriptInterface()
    interface.DisableSolver()
    #gh.Plugin.GH_RhinoScriptInterface.
    interface.OpenDocument(template)
if _template == False and sc.sticky["HLA_Template_edit"] == True:
    interface.EnableSolver()
    sc.sticky["HLA_Template_edit"] = False

# Iterate the GH objects
if ghenv.Component.NickName == "NAME":
    ghenv.Component.Message = None
    ghenv.Component.NickName = username
for obj in ghObjects:
    if type(obj) is gh.Kernel.Special.GH_Panel:
        nn = obj.NickName

        if nn == "Initials, creator":
            if obj.UserText == "":
                obj.UserText = username
                print "Initials, creator to {}".format(username)
            obj.ExpireSolution(True)
            
        if nn == "Initials, last opened by":
            obj.UserText = username
            print "Initials, last opened by {}".format(username)
            obj.ExpireSolution(True)
        
        if nn == "rhino_path":
            if obj.UserText == "":
                obj.UserText = rhino_folder
                obj.ExpireSolution(True)
            
        if nn == "rhino_file":
            if obj.UserText == "":
                obj.UserText = rhino_file
                obj.ExpireSolution(True)
            
        if nn == "project_number":
            if obj.UserText == "":
                obj.UserText = project_number
                obj.ExpireSolution(True)
            
        if nn == "gh_file":
            obj.UserText = gh_file
            obj.ExpireSolution(True)
            
        if nn == "gh_file_path":
            obj.UserText = gh_file_path
            obj.ExpireSolution(True)
            
un = username
# ---------- end mist ----------
doc_properties = CSharpScript(Dsc=" ", Run=True, W=strip_definition)  # -> out, V, N, R, ghP, A, Dc, Dm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; inputs Dsc: String, Run: Boolean, W: Boolean
# ---------- doc_properties: C# ----------
    if(Run && !W){
      clearing = false;
      //Get GH Version
      _V = Grasshopper.Versioning.Version.ToString();
      V = _V;
      //Get GH Document Name
      _N = GrasshopperDocument.DisplayName;
      N = _N;
      //Get Revision Count
      _R = GrasshopperDocument.Properties.Revisions.Count.ToString();
      R = _R;
      //Get GH document Path
      _ghP = GrasshopperDocument.FilePath;
      ghP = _ghP;
      //Get author name
      _A = GrasshopperDocument.Author.Name + " " + GrasshopperDocument.Author.Email;
      A = _A;
      //Verify that the file exists before calling any methods on it - so as to avoid an error on initial open
      if(GrasshopperDocument.FilePath != null && File.Exists(GrasshopperDocument.FilePath)){
        //Get info about file
        System.IO.FileInfo fi = new FileInfo(GrasshopperDocument.FilePath);
        //Get date created
        _Dc = fi.CreationTime.ToString();
        Dc = _Dc;
        //Get date modified
        _Dm = fi.LastWriteTime.ToString();
        Dm = _Dm;
      }
      //two-way description loop:
      bool NoDescription = String.IsNullOrEmpty(Dsc);
      if(NoDescription){
        if(!String.IsNullOrEmpty(GrasshopperDocument.Properties.Description)){
          Grasshopper.Kernel.Special.GH_Panel descPanel = Component.Params.Input[0].Sources.OfType<Grasshopper.Kernel.Special.GH_Panel>().First();
          descPanel.UserText = GrasshopperDocument.Properties.Description;
          descPanel.ExpireSolution(true);
        }

      } else {
        if(Dsc != GrasshopperDocument.Properties.Description){
          GrasshopperDocument.Properties.Description = Dsc;
        }
      }
      //Get Rhino document path, if any
      _rhP = RhinoDocument.Path;
      rhP = _rhP;
      //Get external libraries used in the document:
      _L = String.Join("\n", GetLibrariesFormatted());
      L = _L;

      if(W){
        writeToFile();
      } else {
        Print("Set W to True to write values to file");
      }


      //Add events to trigger component refresh
      GrasshopperDocument.FilePathChanged -= FileChangeHandler;
      GrasshopperDocument.ObjectsAdded -= ObjectEventHandler;
      GrasshopperDocument.ObjectsDeleted -= ObjectEventHandler;
      GrasshopperDocument.FilePathChanged += FileChangeHandler;
      GrasshopperDocument.ObjectsAdded += ObjectEventHandler;
      GrasshopperDocument.ObjectsDeleted += ObjectEventHandler;
    } else {
      clearing = true;
      //Add events to trigger component refresh
      GrasshopperDocument.FilePathChanged -= FileChangeHandler;
      GrasshopperDocument.ObjectsAdded -= ObjectEventHandler;
      GrasshopperDocument.ObjectsDeleted -= ObjectEventHandler;
      if(W){
        DialogResult result = MessageBox.Show("This button clears all Henning Larsen proprietary TEMPLATE scripts from your definition for the purpose of sharing it with consultants and collaborators. This cannot be undone! Are you sure you want to proceed?", "Strip Document", MessageBoxButtons.YesNo);
        if(result == DialogResult.Yes){
          GrasshopperDocument.ScheduleSolution(10, stripItGood);
        }
      }
    }
# ---------- doc_properties: C# additional code ----------
  string _V = "";
  string _N = "";
  string _R = "";
  string _ghP = "";
  string _A = "";
  string _Dc = "";
  string _Dm = "";
  string _L = "";
  string _rhP = "";

  DateTime lastChecked = DateTime.Now;
  bool clearing;
  //Handler for file save
  void FileChangeHandler(object sender, EventArgs e){

    if(clearing) return;

    GrasshopperDocument.ScheduleSolution(5, x => Component.ExpireSolution(false));

  }
  void ObjectEventHandler(object sender, Grasshopper.Kernel.GH_DocObjectEventArgs e){

    if(clearing) return;

    if((DateTime.Now - lastChecked).TotalSeconds > 5){

      if(e.Objects.Where(o => o is IGH_ActiveObject).Count() > 0){
        Component.ExpireSolution(true);
      }
      lastChecked = DateTime.Now;
    }

  }

  void writeToFile(){

  }


  List<IGH_DocumentObject> GetObjectsRecursive(IList<IGH_DocumentObject> objects){
    List<IGH_DocumentObject> results = new List<IGH_DocumentObject>();

    results.AddRange(objects);
    var clusters = objects.Where(o => o is Grasshopper.Kernel.Special.GH_Cluster);

    foreach(Grasshopper.Kernel.Special.GH_Cluster cluster in clusters){
      var doc = cluster.Document("");
      if(doc != null){
        results.AddRange(GetObjectsRecursive(doc.Objects));
      }
    }


    return results;
  }


  List<string> GetLibrariesFormatted(){
    List<string> librariesFormatted = new List<string>();

    var server = Grasshopper.Instances.ComponentServer;

    var objects = GetObjectsRecursive(GrasshopperDocument.Objects);



    var AllLibraries = objects.Select(o => server.FindAssemblyByObject(o)).Distinct();

    var AddOnLibraries = AllLibraries.Where(l => !l.IsCoreLibrary).ToList();

    //Uncomment below in order to include Core libraries as well:
    // var CoreLibraries = AllLibraries.Where(l => l.IsCoreLibrary).ToList();
    // librariesFormatted.Add("Core Libraries:");
    // CoreLibraries.ForEach(l => librariesFormatted.Add(String.Format("{0} {1}", l.Name, l.Version)));
    //  librariesFormatted.Add("Add-on Libraries:");
    AddOnLibraries.ForEach(l => librariesFormatted.Add(String.Format("{0} {1}", l.Name, l.Version)));


    return librariesFormatted;

  }

  Grasshopper.Kernel.Special.GH_Group findGroup(GH_Document doc, string[] keywords){
    var grps = doc.Objects.OfType<Grasshopper.Kernel.Special.GH_Group>();
    foreach(var grp in grps){
      var scribblesInGroup = grp.Objects().OfType<Grasshopper.Kernel.Special.GH_Scribble>();
      if(scribblesInGroup.Count() > 0){
        foreach(var scribble in scribblesInGroup){
          int matches = 0;
          foreach(string keyword in keywords){
            if(scribble.Text.Contains(keyword)) matches++;
          }
          if(matches == keywords.Length){

            return grp;
          }
        }
      }
    }
    return null;
  }

  void stripItGood(GH_Document doc){
    // var panelsGroup = findGroup(doc, new string[]{"General Document Information"});
    var panelScribbleDict = findScribbleByPanel(doc);
    fixPanelsInGroupNew(panelScribbleDict);
    // fixPanelsInGroup(panelsGroup);
    DelGroupContents(doc, findGroup(doc, new string[]{"Template","Script"}));

    DeTelepathize(doc);




  }


  void fixPanelsInGroupNew(Dictionary<string,Grasshopper.Kernel.Special.GH_Panel> panelScribbleDict){

    Dictionary<string,string> labelsAndVariables = new Dictionary<string,string>();
    labelsAndVariables.Add("Grasshopper Version", _V);
    labelsAndVariables.Add("File Name", _N);
    labelsAndVariables.Add("Rev", _R);
    labelsAndVariables.Add("File Path", _ghP);
    labelsAndVariables.Add("Created By", _A);
    labelsAndVariables.Add("Date Created", _Dc);
    labelsAndVariables.Add("Date Updated", _Dm);
    labelsAndVariables.Add("Libraries", _L);
    labelsAndVariables.Add("Associated Rhino File Path", _rhP);

    foreach(string key in labelsAndVariables.Keys){
      try{
        if(key == "Libraries"){
          panelScribbleDict[key].UserText = labelsAndVariables[key].Replace("Telepathy", "").Replace("\n\n", "\n");
        } else {
          panelScribbleDict[key].UserText = labelsAndVariables[key];
        }
      } catch {

      }
    }


  }

  void fixPanelsInGroup(Grasshopper.Kernel.Special.GH_Group grp){
    var panels = grp.ObjectsRecursive().OfType<Grasshopper.Kernel.Special.GH_Panel>();

    foreach(Grasshopper.Kernel.Special.GH_Panel pnl in panels){

      var currText = pnl.VolatileData.AllData(true).First();
      if(pnl.SourceCount > 0){

        pnl.UserText = currText.ToString();
      }

    }
  }


  void DelGroupContents(GH_Document doc, Grasshopper.Kernel.Special.GH_Group grp){
    List<IGH_DocumentObject> dos = new List<IGH_DocumentObject>();
    grp.ObjectsRecursive().ToList().ForEach(g => dos.Add(g));
    doc.RemoveObjects(dos, false);
  }

  void DeTelepathize(GH_Document doc){
    List<IGH_ActiveObject> deleteQueue = new List<IGH_ActiveObject>();
    foreach(IGH_Param ao in doc.ActiveObjects().Where(p => p is IGH_Param).Cast<IGH_Param>()){
      if(ao.GetType().ToString().Contains("Telepathy.Param_Remote")){
        Grasshopper.Kernel.Parameters.Param_GenericObject dataParam = new  Grasshopper.Kernel.Parameters.Param_GenericObject();
        doc.AddObject(dataParam, false, doc.ObjectCount + 1);
        dataParam.Attributes.Pivot = ao.Attributes.Pivot;
        dataParam.NickName = ao.NickName;
        dataParam.WireDisplay = ao.WireDisplay;
        Grasshopper.Kernel.GH_UpgradeUtil.MigrateSources(ao, dataParam);
        Grasshopper.Kernel.GH_UpgradeUtil.MigrateRecipients(ao, dataParam);
        deleteQueue.Add(ao);
      }
    }

    doc.RemoveObjects(deleteQueue, false);
  }


  Dictionary<string,Grasshopper.Kernel.Special.GH_Panel> findScribbleByPanel(GH_Document doc){
    Dictionary<string,Grasshopper.Kernel.Special.GH_Panel> dict = new Dictionary<string,Grasshopper.Kernel.Special.GH_Panel>();
    var scribbles = doc.Objects.OfType<Grasshopper.Kernel.Special.GH_Scribble>().Where(s => s.Attributes.Pivot.X < 0);
    var panels = doc.Objects.OfType<Grasshopper.Kernel.Special.GH_Panel>();
    foreach(Grasshopper.Kernel.Special.GH_Scribble scribble in scribbles){
      Grasshopper.Kernel.Special.GH_Panel closestPanel = null;
      double minDist = Double.MaxValue;
      foreach(Grasshopper.Kernel.Special.GH_Panel p in panels){
        double dist = pfDist(p.Attributes.Pivot, scribble.Attributes.Pivot);
        if(closestPanel == null || dist < minDist){
          minDist = dist;
          closestPanel = p;
        }
      }
      if(dict.ContainsKey(scribble.Text)){
        if(pfDist(scribble.Attributes.Pivot, dict[scribble.Text].Attributes.Pivot) < minDist){
          dict[scribble.Text] = closestPanel;
        }
      } else {
        dict.Add(scribble.Text, closestPanel);
      }
    }
    return dict;
  }

  double pfDist(PointF frm, PointF to){

    return Math.Pow((frm.X - to.X), 2) + Math.Pow((frm.Y - to.Y), 2);
  }
# ---------- end doc_properties ----------
grpclr = CSharpScript(run=True)  # -> A; inputs run: Boolean
# ---------- grpclr: C# ----------
    GrasshopperDocument.ObjectsAdded -= ObjectsAdded;
    GrasshopperDocument.ObjectsDeleted -= ObjectsRemoved;
    if(run)
    {

      if(firstRun){
//        using (StreamWriter f = File.AppendText(@"C:\My Documents\Desktop\UndoLog.txt"))
//        {
//          f.WriteLine("FirstRun");
//
//        }
        var groups = GrasshopperDocument.Objects.OfType<Grasshopper.Kernel.Special.GH_Group>().ToList();
        groups.ForEach(g => attachEvent(g));

        groups.ForEach(g => colorGroup(g));
        firstRun = false;
      }

      GrasshopperDocument.ObjectsAdded += ObjectsAdded;
      GrasshopperDocument.ObjectsDeleted += ObjectsRemoved;
    } else {
      var groups = GrasshopperDocument.Objects.OfType<Grasshopper.Kernel.Special.GH_Group>().ToList();
      groups.ForEach(g => detachEvent(g));
      firstRun = true;

    }
# ---------- grpclr: C# additional code ----------
  bool firstRun = true;
  void ObjectsAdded(object sender, GH_DocObjectEventArgs e){
//    using (StreamWriter f = File.AppendText(@"C:\My Documents\Desktop\UndoLog.txt"))
//    {
//      f.WriteLine("ObjectsAdded");
//
//    }
    var groups = e.Objects.OfType<Grasshopper.Kernel.Special.GH_Group>();
    if(groups.Count() == 0) return;

    foreach(Grasshopper.Kernel.Special.GH_Group grp in groups){
//      using (StreamWriter f = File.AppendText(@"C:\My Documents\Desktop\UndoLog.txt"))
//      {
//        f.WriteLine("Adding event to group");
//      }
      attachEvent(grp);

    }
  }

  void attachEvent(Grasshopper.Kernel.Special.GH_Group grp){
    grp.ObjectChanged += GroupAttributesChanged;
  }

  void detachEvent(Grasshopper.Kernel.Special.GH_Group grp){
    grp.ObjectChanged -= GroupAttributesChanged;
  }

  void ObjectsRemoved(object sender, GH_DocObjectEventArgs e){
//    using (StreamWriter f = File.AppendText(@"C:\My Documents\Desktop\UndoLog.txt"))
//    {
//      f.WriteLine("ObjectsRemoved");
//
//    }
    var groups = e.Objects.OfType<Grasshopper.Kernel.Special.GH_Group>();
    if(groups.Count() == 0) return;

    foreach(Grasshopper.Kernel.Special.GH_Group grp in groups){

      detachEvent(grp);
    }
  }

  void GroupAttributesChanged(object sender, EventArgs e){
//    using (StreamWriter f = File.AppendText(@"C:\My Documents\Desktop\UndoLog.txt"))
//    {
//      f.WriteLine("GroupAttributesChanging");
//
//
//    }
    colorGroup(sender as Grasshopper.Kernel.Special.GH_Group);
  }


  void colorGroup(Grasshopper.Kernel.Special.GH_Group grp){
    var groups = GrasshopperDocument.Objects.OfType<Grasshopper.Kernel.Special.GH_Group>();

    var keyGroups = groups.Where(g => g.NickName.Reverse().ToArray().FirstOrDefault() == '_');
    var otherGroups = groups.Except(keyGroups);

    if(keyGroups.Contains(grp)) return;

    var keyDictionary = keyGroups.ToDictionary(g => g.NickName, g => g.Colour);

    var splits = grp.NickName.Split('_');
     if(splits.Length == 1) return;
    var prefix = splits[0];
    prefix += '_';
    if(keyDictionary.ContainsKey(prefix)){
      grp.Colour = keyDictionary[prefix];
      grp.NickName = grp.NickName.Replace(prefix, "");

    }
  }
# ---------- end grpclr ----------

# ----
# Associated Rhino File Path
# Libraries
# Copyright Henning Larsen/Rambøll
# Note
# USAGE OF THE SCRIPT IS AT OWN RISK AND OUTPUTS SHOULD BE CONTROLLE BY USER.
# 
# ALL IP IN THE SCRIPT IS NOT TO BE SHARED WITH ANYONE OUTSIDE PROJECT SCOPE
# 
# COPYRIGHT 2020
panel_2 = Panel(doc_properties.L)
# Document Dependencies
rhino_path = Panel("rhino.folder")

panel_3 = Panel(doc_properties.V)
panel_4 = Panel(doc_properties.Dc)
panel_5 = Panel(doc_properties.Dm)

# ==== cluster HLSETUP
installtemplate = ClusterInput()
setup = HLSetup(installTemplate=installtemplate)  # -> out; inputs installTemplate: Boolean
# ---------- setup: Python ----------
"""
HLA SETUP FILE
Sets wire colours and copyright info.
TODO: Updates for plugins also.
"""

ghenv.Component.Name = "HL Setup"
ghenv.Component.NickName = 'Setup'
ghenv.Component.Message = 'HL 2020/04 MANI'
ghenv.Component.IconDisplayMode = ghenv.Component.IconDisplayMode.name
ghenv.Component.Category = "HLA"
ghenv.Component.SubCategory = "1 | Setup"

try:
    from clr import AddReference
    clr.AddReference("Grasshopper")
except:
    pass

import Grasshopper
import Grasshopper.CentralSettings as cs
import getpass
import System
import os
import shutil
from datetime import datetime
now = datetime.now()

Grasshopper.GUI.Canvas.GH_Skin.panel_back = System.Drawing.Color.FromArgb(240,255,255,255)
Grasshopper.GUI.Canvas.GH_Skin.group_back = System.Drawing.Color.FromArgb(200,245,236,215)
Grasshopper.GUI.Canvas.GH_Skin.wire_selected_b  = System.Drawing.Color.Teal
Grasshopper.GUI.Canvas.GH_Skin.wire_selected_a  = System.Drawing.Color.Gold

print "Changed default colors in GH - Enjoy!"

cs.AuthorAddress = "Vesterbrogade 76"
cs.AuthorCompany = "Henning Larsen"
cs.AuthorCopyright = now.strftime("%Y")
cs.AuthorName = getpass.getuser()
cs.AuthorWebsite = "www.henninglarsen.com"
print "Set copyright info for %s" % getpass.getuser()



#print Grasshopper.Folders.DefaultTemplateFolder
#print Grasshopper.Folders.DefaultUserObjectFolder
#print Grasshopper.Folders.DefaultAssemblyFolder

#print Grasshopper.Utility.GetHashCode("lol")


def recursive_overwrite(src, dest, ignore=None):
    if os.path.isdir(src):
        if not os.path.isdir(dest):
            os.makedirs(dest)
        files = os.listdir(src)
        if ignore is not None:
            ignored = ignore(src, files)
        else:
            ignored = set()
        for f in files:
            if f not in ignored:
                recursive_overwrite(os.path.join(src, f), 
                                    os.path.join(dest, f), 
                                    ignore)
    else:
        shutil.copyfile(src, dest)

def ignore(*args):
    return set(["Setup"])


path = "//files\\MergedCompanies\\HenningLarsen\\Denmark\\Copenhagen\\Workspace\\Rhino\\HLA_Grasshopper\\HLA_Template.gh"
cs.TemplateFile = path
print "changed your template folder!"


if installTemplate == True:
    src = "//files\\MergedCompanies\\HenningLarsen\\Denmark\\Copenhagen\\Workspace\\Rhino\\HLA_Grasshopper\\UserObjects"
    recursive_overwrite(src, Grasshopper.Folders.DefaultUserObjectFolder, ignore = ignore)
    
    src = "//files\\MergedCompanies\\HenningLarsen\\Denmark\\Copenhagen\\Workspace\\Rhino\\HLA_Grasshopper\\Libraries"
    recursive_overwrite(src, Grasshopper.Folders.DefaultAssemblyFolder, ignore = ignore)
    print "Copied Libraries and user objects to locally"






"""
RHINO 6


component = ghenv.Component
class Cntxt(component):
    def __init__(self):
        super(Cntxt,self).__init__()
        self.enabled = False
        
    def RunScript(self):
        a = self.enabled
        return a
        
    def OnTextMenuClick(self, sender, args):
        try: #always try....
            self.enabled = not self.enabled
            System.Windows.Forms.MessageBox.Show("I am now {}...".format(self.enabled))
        
            self.ExpireSolution(True)
        except Exception, ex:
            System.Windows.Forms.MessageBox.Show(str(ex))
            
            try:
                image = None
                    
                item = items.Item.Add("Additional state to: {}".format(not self.enabled), image, self.OnTextMenuClick)
                    
                item.Checked = self.enabled
            except Exception, ex:
                System.Windows.Forms.MessageBox.Show(str(ex))

menuItem = Cntxt()

"""
# ---------- end setup ----------
panel = Panel(setup)
out = ClusterOutput(setup)

# ==== cluster HL_LAYER
create_missing_layers = ClusterInput()
recreate_all_layers = ClusterInput()
create_missing_layers_2 = Boolean(create_missing_layers)
recreate_all_layers_2 = Boolean(recreate_all_layers)
name = Data(["00_FileSetUp", "00_FileSetUp::Start Up text", "00_2D", "00_2D::01_HELP", "00_2D::01_HELP::01_Site", "00_2D::01_HELP::01_Grid", "00_2D::01_HELP::01_Level", "00_2D::01_HELP::01_Text", "00_2D::02_SITE", "00_2D::02_SITE::02_(should be Worksession)"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])
color = Data([RGB(0, 0, 0), RGB(0, 0, 0), RGB(0, 0, 0), RGB(0, 0, 0), RGB(0, 0, 0), RGB(109, 109, 109)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])
layertable = LayerTable(Update=create_missing_layers_2, AutoUpdate=False)  # -> Layers, FullLayerPaths, LayerColors, Linetypes, MaterialNames, Visible, PrintWidth, PrintColor
cull = CullPattern(List=name, CullPattern=create_missing_layers_2)
cull_2 = CullPattern(List=layertable.FullLayerPaths, CullPattern=create_missing_layers_2)
cull_3 = CullPattern(List=name, CullPattern=recreate_all_layers_2)
cull_4 = CullPattern(List=color, CullPattern=recreate_all_layers_2)
x_y = XY(Expression="x=y", X=graft(cull), Y=cull_2)
ma = MassAddition(Input=x_y)  # -> flatten(Result), PartialResults
layers = CreateModifyLayers(LayerName=cull_3, LayerColor=cull_4, DeleteLayer=False, enableFullPath=True)  # -> LayerNames, LayerFullPath
bool = Boolean(invert(ma.Result))
and = GateAnd(A=bool, B=create_missing_layers_2)
cull_5 = CullPattern(List=name, CullPattern=and)
cull_6 = CullPattern(List=color, CullPattern=and)
layers_2 = CreateModifyLayers(LayerName=cull_5, LayerColor=cull_6, DeleteLayer=False, enableFullPath=True)  # -> LayerNames, LayerFullPath
